# Grasshopper definition brick jaali with 3 attractors.gh (Grasshopper 1.0.8)

number_slider = Slider(75, range=0..100)
point = Point(Point(0, 0, 0))
point_2 = Point(Point(115, 230, 75))
unit_z = UnitZ(Factor=number_slider)
box_2pt = Box2Pt(PointA=point, PointB=point_2, Plane=PlaneXY(0, 0, 0))
division = Division(A=Slider(3000, range=0..10000), B=number_slider)
integer = Integer(division)
curve = Curve(<curve referenced from the Rhino model>)
length = Length(Curve=curve)
linear_array = LinearArray(Geometry=box_2pt, Direction=unit_z, Count=integer)  # -> Geometry, Transform
division_2 = Division(A=length, B=Slider(230, range=0..1000))
integer_2 = Integer(division_2)
curve_array = CurveArray(Geometry=linear_array.Geometry, Curve=curve, Count=integer_2)  # -> Geometry, Transform
list_item = ListItem(List=curve_array.Geometry, Index=34, Wrap=True)
area = Area(Geometry=list_item)  # -> Area, Centroid
area_2 = Area(Geometry=linear_array.Geometry)  # -> Area, Centroid
polyline = PolyLine(Vertices=flatten(area.Centroid), Closed=False)
polyline_2 = PolyLine(Vertices=area_2.Centroid, Closed=False)
number_slider_2 = Slider(0.273, range=0..1)
number_slider_3 = Slider(0.506, range=0..1)
number_slider_4 = Slider(0.517, range=0..1)
number_slider_5 = Slider(0.675, range=0..1)
number_slider_6 = Slider(0.106, range=0..1)
number_slider_7 = Slider(0.94, range=0..1)
curve_2 = Curve(polyline_2)
curve_3 = Curve(polyline)
loft = Loft(
    Curves=flatten([curve_2, curve_3]),
    Options={Adjust=False, Closed=False, LoftEnds=0, LoftSimp=0, LoftType=0, Rebuild=10, Refit=0.01})
construct_point = ConstructPoint(XCoordinate=number_slider_2, YCoordinate=number_slider_3, ZCoordinate=0)
construct_point_2 = ConstructPoint(XCoordinate=number_slider_4, YCoordinate=number_slider_5, ZCoordinate=0)
construct_point_3 = ConstructPoint(XCoordinate=number_slider_6, YCoordinate=number_slider_7, ZCoordinate=0)
area_3 = Area(Geometry=flatten(curve_array.Geometry))  # -> Area, Centroid
geometry = Geometry(loft)
evaluate_surface = EvaluateSurface(Surface=reparameterize(geometry), Point=construct_point_2)  # -> Point, Normal, UDirection, VDirection, Frame
evaluate_surface_2 = EvaluateSurface(Surface=reparameterize(geometry), Point=construct_point)  # -> Point, Normal, UDirection, VDirection, Frame
evaluate_surface_3 = EvaluateSurface(Surface=reparameterize(geometry), Point=construct_point_3)  # -> Point, Normal, UDirection, VDirection, Frame
distance = Distance(PointA=evaluate_surface.Point, PointB=flatten(area_3.Centroid))
distance_2 = Distance(PointA=evaluate_surface_2.Point, PointB=flatten(area_3.Centroid))
distance_3 = Distance(PointA=evaluate_surface_3.Point, PointB=flatten(area_3.Centroid))
sphere = Sphere(Base=[evaluate_surface_2.Point, evaluate_surface.Point, evaluate_surface_3.Point], Radius=Slider(202, range=0..10000))
bounds = Bounds(Numbers=distance_2)
bounds_2 = Bounds(Numbers=distance_3)
bounds_3 = Bounds(Numbers=distance)
custom_preview = CustomPreview(Geometry=sphere, Material=ColourSwatch(SwatchColor=RGB(255, 255, 255)))
remap_numbers = RemapNumbers(Value=distance_2, Source=bounds, Target="-45 to 45")  # -> Mapped, Clipped
remap_numbers_2 = RemapNumbers(Value=distance_3, Source=bounds_2, Target="-45 to 45")  # -> Mapped, Clipped
remap_numbers_3 = RemapNumbers(Value=distance, Source=bounds_3, Target="-45 to 45")  # -> Mapped, Clipped
addition = Addition(A=remap_numbers.Mapped, B=remap_numbers_3.Mapped, C=remap_numbers_2.Mapped)
rotate = Rotate(Geometry=flatten(curve_array.Geometry), Angle=degrees(addition), Plane=flatten(area_3.Centroid))  # -> Geometry, Transform
brep = Brep(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)
vector_2pt = Vector2Pt(PointA=Point(4944.647011, -9229.375054, 15420.78153), PointB=Point(2312.255514, 2041.349707, 0), Unitize=False)  # -> Vector, Length
mesh_shadow = MeshShadow(Mesh=rotate.Geometry, Light=vector_2pt.Vector, Plane=brep)
region_union = RegionUnion(Curves=flatten(mesh_shadow))
area_4 = Area(Geometry=region_union)  # -> Area, Centroid
mass_addition = MassAddition(Input=area_4.Area)  # -> Result, PartialResults
galapagos = Galapagos(
    fitness=mass_addition,
    gene=[number_slider_2, number_slider_3, number_slider_4, number_slider_5, number_slider_6, number_slider_7])
