# Grasshopper definition brick jaali.gh (Grasshopper 1.0.8)

point = Point(Point(115, 230, 75))
point_2 = Point(Point(0, 0, 0))
box_2pt = Box2Pt(PointA=point_2, PointB=point, Plane=PlaneXY(0, 0, 0))
unit_x = UnitX(Factor=Slider(500, range=0..1000))
brick = Geometry(box_2pt)
unit_z = UnitZ(Factor=Slider(75, range=0..100))
linear_array = LinearArray(Geometry=brick, Direction=unit_x, Count=Slider(20, range=0..100))  # -> Geometry, Transform
linear_array_2 = LinearArray(Geometry=linear_array.Geometry, Direction=unit_z, Count=Slider(40, range=0..100))  # -> Geometry, Transform
area = Area(Geometry=linear_array_2.Geometry)  # -> Area, Centroid
vector_2pt = Vector2Pt(PointA=Point(3204.89992, -4632.835464, 6364.485418), PointB=Point(422.6631743, 868.4053754, 0), Unitize=False)  # -> Vector, Length
brep = Brep(<brep referenced from the Rhino model>)
vector_display = VectorDisplay(Anchor=Point(3204.89992, -4632.835464, 6364.485418), Vector=vector_2pt.Vector)
gene_pool = GenePool(Decimals=0, Maximum=90, Minimum=-90, Value=[41, -34, 36, 9, 59, 18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])
rotate = Rotate(Geometry=flatten(linear_array_2.Geometry), Angle=gene_pool, Plane=flatten(area.Centroid))  # -> Geometry, Transform
mesh_shadow = MeshShadow(Mesh=rotate.Geometry, Light=vector_2pt.Vector, Plane=brep)
region_union = RegionUnion(Curves=flatten(mesh_shadow))
area_2 = Area(Geometry=region_union)  # -> Area, Centroid
mass_addition = MassAddition(Input=area_2.Area)  # -> Result, PartialResults
galapagos = Galapagos(fitness=mass_addition, gene=gene_pool)
